# Grasshopper definition _portal-overview.gh (Grasshopper 1.0.7)
# plug-ins: Portal, Bifocals

# ----
# You can add as many metadata as you need to each geometry
panel = Panel("Some Prop")
srmeta = SerializeMetadata(Name="Some Mesh", OtherProp=panel)
panel_2 = Panel(srmeta)

# ----
# Portal 0.5.1+
# Get Active Camera
trigger = Trigger(Interval=10, TimerInterval=10, Target=camera)
camera = GetCamera()
panel_3 = Panel(camera)

# ----
# Byte Conversion
# Direct conversion
panel_4 = Panel("this is a string")
camera_2 = GetCamera()
bytes = Bytes(camera_2)
bytes_2 = Bytes(panel_4)
panel_5 = Panel(bytes_2)

# ---- group: Enable for dynamic update
trigger_2 = Trigger(Interval=10, TimerInterval=10, Target=objmeta)  # disabled

# ---- group: reference a mesh in rhino
# Layer & Material
# Blender accept layer and material information if exist.
# This only works if it's a reference geometry
referenced_mesh = Mesh(<mesh referenced from the Rhino model>)

# ----
# Mesh Vertex Color
# Optionally vertex color can be serialized and send as part
# of the packet. Defaults empty list.
mesh = Mesh(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)
mcol = MeshColours(Mesh=mesh, Colours=ColourSwatch(SwatchColor=RGB(255, 255, 255)))
srgeo = SerializeGeometry(Geometry=mcol)

# ---- group: Reference a light
# Light
id = Guid([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])

# ----
objmeta = ObjectMeta(Geometry=referenced_mesh)  # -> Id, Layer, Material
srmeta_2 = SerializeMetadata(Id=objmeta.Id, Layer=objmeta.Layer, Material=objmeta.Material)
panel_6 = Panel(srmeta_2)
srgeo_2 = SerializeGeometry(Geometry=referenced_mesh, Metadata=srmeta_2)
pack = PackPayload(Payloads=srgeo_2, isBeautify=True)

srlight = GetLight(LightGUID=id)
panel_7 = Panel(srlight)

panel_8 = Panel(bytes)
payload = Panel(srgeo)
payload_2 = Panel(pack)
trigger_3 = Trigger(Interval=100, TimerInterval=100, Target=mmf_2)  # disabled

# ----
# Geometry Serialization
mesh_2 = Mesh(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)
crv = Curve(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)
pt = Point(Point(-16.48373174, -4.378032136, 0))
srgeo_3 = SerializeGeometry(Geometry=[mesh_2, pt, crv])

# ----
# Network Informations
info = NetworkInfo()  # -> Properties, LocalIP
panel_9 = Panel(info.Properties)
your_main_local_ip = Panel(info.LocalIP)

serialized_points = Panel(srgeo_3)
dsrgeo = DeserializeGeometry(Payload=srgeo_3)  # -> Geometry, Metadata

# ----
# Geometry Deserialization
deserialized_mesh = Panel(dsrgeo.Geometry)

# ----
# Metadata add additional information for each geometry
panel_10 = Panel("Some Prop")
# Metadata
panel_11 = Panel("Some Point")
srmeta_3 = SerializeMetadata(Name=panel_11, OtherProp=panel_10)
pt_2 = Point([Point(6.052849799, -3.32025256, 0), Point(-0.3525931922, -0.9108657465, 0), Point(-4.936304691, -1.145927875, 0)])

srgeo_4 = SerializeGeometry(Geometry=pt_2, Metadata=srmeta_3)
panel_12 = Panel(srmeta_3)

pack_2 = PackPayload(Payloads=srgeo_4, isBeautify=True)

# ----
# Memory Mapped File: Description:
# Memory-Mapped Files map a portion of memory to the address space of a process for efficient inter-process communication (IPC).
# 
# Usage:
# - Ideal for extremely fast read and write operations directly in shared memory.
# 
# Warning:
# - Limited to the local machine.
# - May cause data corruption, memory leaks, or program crashes if not handled properly.
payload_3 = Panel(pack_2)

# ----
# Encoder conversion
panel_13 = Panel("this is a string")
enb = BytesEncoder(Text=panel_13, Compress=False)

bytes_3 = Bytes(enb)

panel_14 = Panel(bytes_3)

# ----
# Cannot convert other than string
mesh_3 = Mesh(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)

bytes_4 = Bytes(mesh_3)

panel_15 = Panel(bytes_4)

# ----
# Need to serialize geometry and pack a payload before sending
mesh_4 = Mesh(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)

srgeo_5 = SerializeGeometry(Geometry=mesh_4)
pack_3 = PackPayload(Payloads=srgeo_5, isBeautify=False)
bytes_5 = Bytes(pack_3)

panel_16 = Panel(bytes_5)

# ----
# It can be be individually set by a list
panel_17 = Panel("PointA")
pt_3 = Point([Point(6.052849799, -3.32025256, 0), Point(-0.3525931922, -0.9108657465, 0), Point(-4.936304691, -1.145927875, 0)])
srmeta_4 = SerializeMetadata(Name=panel_17)
srmeta_5 = SerializeMetadata(Name="PointB")

merge = Merge(Data1=srmeta_4, Data2=srmeta_5)

srgeo_6 = SerializeGeometry(Geometry=pt_3, Metadata=merge)
pack_4 = PackPayload(Payloads=srgeo_6, isBeautify=True)

payload_4 = Panel(pack_4)

# ----
# WebSockets
# Named Pipe: Description:
# Named Pipes allow inter-process communication (IPC) through a unidirectional pipe.
# 
# Usage:
# - Useful for scenarios requiring fast, reliable, ordered, and byte-stream-based communication.
# 
# Warning:
# - Limited to local machine
panel_18 = Panel("something")
# Websockets: Description:
# Websockets provide a stable connection, capable of handling large payloads.
# 
# Usage:
# - Best for large, content-critical payloads where data integrity is crucial.
# - Suitable for both local and cross-machine communication.
# 
# Warning:
# - Slower transmission speed.
# - Requires the server to start first to establish a connection.
panel_19 = Panel("abc")
srmeta_6 = SerializeMetadata(Name=panel_19, Material="wood", Others=panel_18)
mesh_5 = Mesh(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)
number_slider = Slider(6001, range=0..10000)
ws_server = WebSocketServer(Port=number_slider, Route="/test", Start=Toggle(False))
deb = BytesDecoder(Bytes=ws_server)

srgeo_7 = SerializeGeometry(Geometry=mesh_5, Metadata=srmeta_6)
pack_5 = PackPayload(Payloads=srgeo_7, isBeautify=False)
unpack = UnpackPayload(JsonString=deb)  # -> Payloads, Metadata
dsrgeo_2 = DeserializeGeometry(Payload=unpack.Payloads)  # -> Geometry, Metadata
dsrmeta = DeserializeMetadata(Json=dsrgeo_2.Metadata)  # -> Name, Material, Others

enb_2 = BytesEncoder(Text=pack_5, Compress=Toggle(True))
ws_client = WebSocketClient(HostIP="127.0.0.1", Port=number_slider, Route="/test", Bytes=enb_2, Send=Button())
panel_20 = Panel(dsrgeo_2.Geometry)
panel_21 = Panel(dsrmeta.Others)

panel_22 = Panel(dsrmeta.Name)
# Serialization: Description:
# Serialize geometry to a JSON string with common properties, enabling receivers to understand and reconstruct the geometry. The serialized data is generic and not platform-specific.
# 
# Usage:
# - Facilitates the transmission and reconstruction of geometry data across different programs.
panel_23 = Panel(dsrmeta.Material)

# ----
# UDP
# UDP: Description:
# UDP provides fast, connectionless transmission.
# 
# Usage:
# - Ideal for payloads under 1472 bytes needing quick, straightforward transmission without connection setup or integrity checks (e.g., sending small instructions).
# - Supports cross-machine communication.
# 
# Warning:
# - Not suitable for payloads over 1472 bytes.
# - Data may become corrupted due to fragmentation.
number_slider_2 = Slider(6000, range=0..10000)
udp = UDPSender(ServerIP="127.0.0.1", Port=number_slider_2, Bytes="hey there from client", Send=Button())
udp_2 = UdpReceiver(Port=number_slider_2, Start=Toggle(False))

deb_2 = BytesDecoder(Bytes=udp_2)

panel_24 = Panel(deb_2)

# ----
# File I/O: Description:
# File I/O operations allow reading from and writing to files on a storage device.
# 
# Usage:
# - Suitable for scenarios requiring persistent storage of data.
# 
# Warning:
# - Limited to the local machine.
# - Disk I/O operations can be slow compared to memory operations.
# File I/O
panel_25 = Panel("hey there from grasshopper")
file = FileReader(FilePath="D:\test.txt")

file_2 = FileWriter(Bytes=panel_25, FilePath="D:\test.txt", Write=Button())
deb_3 = BytesDecoder(Bytes=file)
deb_4 = BytesDecoder(Bytes=file)

panel_26 = Panel(deb_3)

# ----
# Named Pipe
panel_27 = Panel("hey there from pipe ")
pipe = PipeSender(PipeName="TestPipe", Bytes=panel_27, Send=Toggle(False))
pipe_2 = PipeReceiver(PipeName="TestPipe", Start=Toggle(False))

deb_5 = BytesDecoder(Bytes=pipe_2)

panel_28 = Panel(deb_5)

# ----
# Memory Mapped File
panel_29 = Panel("hey there from mmf ")
mmf = SharedMemoryWriter(MemoryName="TestMemoryBlock", Bytes=panel_29, Write=Toggle(False))

mmf_2 = SharedMemoryReader(MemoryName="TestMemoryBlock")
deb_6 = BytesDecoder(Bytes=mmf_2)

panel_30 = Panel(deb_6)

# ----
# Encryption: Description:
# Encrypt binary data using the AES symmetric encryption algorithm with a password.
# 
# Usage:
# - Secure data transmission for cross-machine communication.
# 
# Warning:
# - Encryption and decryption will take additional time.
# Data Encryption
mesh_6 = Mesh(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)

srgeo_8 = SerializeGeometry(Geometry=mesh_6)
pack_6 = PackPayload(Payloads=srgeo_8, isBeautify=False)

enb_3 = BytesEncoder(Text=pack_6, Compress=Toggle(True), Password="password123")

compressed_encrypted = Panel(enb_3)

# ----
# Mesh Serialization + compression
# Compression: Description:
# Compress binary data using the GZip algorithm.
# 
# Usage:
# - Ideal for transmitting large data as it reduces payload size, bandwidth, and memory usage, while increasing transmission speed.
# 
# Warning:
# - Not suitable for small data as it may increase the size.
mesh_7 = Mesh(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)

srgeo_9 = SerializeGeometry(Geometry=mesh_7)
pack_7 = PackPayload(Payloads=srgeo_9, isBeautify=False)

enb_4 = BytesEncoder(Text=pack_7, Compress=Toggle(True))
enb_5 = BytesEncoder(Text=pack_7, Compress=False)

uncompressed = Panel(enb_5)
compressed = Panel(enb_4)

# ----
# Data Decryption
panel_31 = Panel("password123")
deb_7 = BytesDecoder(Bytes=enb_3, Password=panel_31)

unpack_2 = UnpackPayload(JsonString=deb_7)  # -> Payloads, Metadata
dsrgeo_3 = DeserializeGeometry(Payload=unpack_2.Payloads)  # -> Geometry, Metadata

panel_32 = Panel(dsrgeo_3.Geometry)

# ----
# Mesh Deserialization + decompression
deb_8 = BytesDecoder(Bytes=enb_4)

unpack_3 = UnpackPayload(JsonString=deb_8)  # -> Payloads, Metadata
dsrgeo_4 = DeserializeGeometry(Payload=unpack_3.Payloads)  # -> Geometry, Metadata

panel_33 = Panel(dsrgeo_4.Geometry)
