# Grasshopper definition gh-blender-memory-mapped-file.gh (Grasshopper 1.0.7)
# plug-ins: Portal, Bifocals

# Portal GH == 0.3.0
# Portal Blender == 0.0.3
number_slider = Slider(0.5, range=0..1)

# ---- group: Input 1
mesh_frame = Mesh(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)

# ---- group: Input 2
mesh_glass = Mesh(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)

# ----
# "Material" must exactly match
# the Blender material name for
# correct assignment. Otherwise will
# be ignore.
material_name = Panel("Glass")
object_name = Panel("frame")
material_name_2 = Panel("Steel")
object_name_2 = Panel("glass-panel")
# Mesh vertex colors
# can be read and applied
# by Blender.
mcol = MeshColours(Mesh=mesh_glass, Colours=ColourSwatch(SwatchColor=RGB(255, 0, 0)))
srmeta = SerializeMetadata(Name=object_name, Material=material_name_2)
srmeta_2 = SerializeMetadata(Name=object_name_2, Material=material_name)
srmesh = SerializeMesh(Mesh=mesh_frame)
srmesh_2 = SerializeMesh(Mesh=mcol)
merge = Merge(Data1=srmesh, Data2=srmesh_2)
merge_2 = Merge(Data1=srmeta, Data2=srmeta_2)
panel = Panel(merge_2)
# Pack data and metadata into a
#  single string before encoding
# as bytes for transmission.
pack = PackPayload(Data=merge, Metadata=merge_2, isBeautify=False)
enb = BytesEncoder(Text=pack, Compress=Toggle(True))
# Blender Server
mmf = SharedMemoryWriter(MemoryName="memory_file", Bytes=enb, Write=Toggle(False))
