# Grasshopper definition gh-blender-pipe (light sync).gh (Grasshopper 1.0.7)
# plug-ins: Portal

# Portal GH == 0.5.1+
# Portal Blender == 0.2.1+
# Grasshopper -> Blender: NamedPipe
trigger = Trigger(Interval=100, TimerInterval=100, Target=srlight)
id = Guid([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])
srlight = GetLight(LightGUID=flatten(id))
pipe = PipeSender(PipeName="channel-1", Bytes=srlight, Send=Toggle(False))
