# Grasshopper definition gh-blender-pipe (multi-channel, cam sync).gh (Grasshopper 1.0.7)
# plug-ins: Portal, Bifocals

trigger = Trigger(Interval=10, TimerInterval=10, Target=objmeta)

# ---- group: Reference Geometry
# Portal GH == 0.4.0+
# Portal Blender == 0.1.0+
# Grasshopper -> Blender: NamedPipe
mesh_frame = Mesh([<mesh referenced from the Rhino model> x2])

# ----
objmeta = ObjectMeta(Geometry=mesh_frame)  # -> Id, Layer, Material
# You can also replace Material property
# with a string to assign pre-existing
# material in blender.
panel = Panel("Frame")
srmeta = SerializeMetadata(Id=objmeta.Id, Layer=objmeta.Layer, Material=objmeta.Material)
trigger_2 = Trigger(Interval=10, TimerInterval=10, Target=camera)
srgeo = SerializeGeometry(Geometry=mesh_frame, Metadata=srmeta)
camera = GetCamera()
# Pack data and metadata into a
#  single string before encoding
# as bytes for transmission.
pack = PackPayload(Payloads=srgeo, isBeautify=False)
enb = BytesEncoder(Text=pack, Compress=Toggle(True))
enb_2 = BytesEncoder(Text=camera, Compress=Toggle(True))
# Channel-1
pipe = PipeSender(PipeName="channel-1", Bytes=enb, Send=Toggle(False))
# Channel-2
# Make sure to also open a
# second channel in blender
# and select `DataType` to `Camera`
pipe_2 = PipeSender(PipeName="channel-2", Bytes=enb_2, Send=Toggle(False))
