# Grasshopper definition gh-blender-pipe (recv, trigger on render complete).gh (Grasshopper 1.0.7)
# plug-ins: Portal

# Portal GH == 0.5.1+
# Portal Blender == 0.2.1+
# Blender -> Grasshopper: NamedPipe
panel = Panel("channel-1")
pipe = PipeReceiver(PipeName=panel, Start=Toggle(False))
deb = BytesDecoder(Bytes=pipe)
# Blender Setup:
# - Direction: Send
# - Trigger Event: Render Complete
# - Data Editor:
#     - key-1 = Timestamp
dsrmeta = DeserializeMetadata(Json=deb)
concat = Concatenate(FragmentA="render complete:", FragmentB=dsrmeta)
panel_2 = Panel(concat)
