# Grasshopper definition gh-blender-websockets.gh (Grasshopper 1.0.7)
# plug-ins: Bifocals, Portal

# "Material" must exactly match
# the Blender material name for
# correct assignment. Otherwise will
# be ignore.
# 
# The material needs to be
# pre-exists in blender for it to take effect.
material_name = Panel("Glass")
object_name = Panel("glass-panel")
object_name_2 = Panel("frame")
material_name_2 = Panel("Steel")

# ---- group: Input 2
mesh_glass = Mesh(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)

# ---- group: Input 1
# Portal GH == 0.3.1
# Portal Blender == 0.0.3
# Grasshopper -> Blender Websockets
mesh_frame = Mesh(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)

# ----
srmeta = SerializeMetadata(Name=object_name, Material=material_name)
srmeta_2 = SerializeMetadata(Name=object_name_2, Material=material_name_2)
# Mesh vertex colors
# can be read and applied
# by Blender.
mcol = MeshColours(Mesh=mesh_glass, Colours=ColourSwatch(SwatchColor=RGB(255, 0, 0)))
panel = Panel(srmeta)
panel_2 = Panel(srmeta_2)
srmesh = SerializeMesh(Mesh=mesh_frame, Metadata=srmeta_2)
srmesh_2 = SerializeMesh(Mesh=mcol, Metadata=srmeta)
merge = Merge(Data1=srmesh, Data2=srmesh_2)
# Pack data and metadata into a
#  single string before encoding
# as bytes for transmission.
pack = PackPayload(Payloads=merge, isBeautify=False)
enb = BytesEncoder(Text=pack, Compress=Toggle(True))
# Blender Server
ws_client = WebSocketClient(HostIP="127.0.0.1", Port=Slider(8765, range=0..10000), Route="/", Bytes=enb, Send=Toggle(False))
