# Grasshopper definition portal-example.gh (Grasshopper 1.0.7)
# plug-ins: Portal, Bifocals

# ----
# Byte Conversion
# Direct conversion
panel = Panel("this is a string")
bytes = Bytes(panel)
panel_2 = Panel(bytes)

# ----
# Websockets: Description:
# Websockets provide a stable connection, capable of handling large payloads.
# 
# Usage:
# - Best for large, content-critical payloads where data integrity is crucial.
# - Suitable for both local and cross-machine communication.
# 
# Warning:
# - Slower transmission speed.
# - Requires the server to start first to establish a connection.
# Named Pipe: Description:
# Named Pipes allow inter-process communication (IPC) through a unidirectional pipe.
# 
# Usage:
# - Useful for scenarios requiring fast, reliable, ordered, and byte-stream-based communication.
# 
# Warning:
# - Limited to local machine
mesh = Mesh(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)
srmesh = SerializeMesh(Mesh=mesh)
enb = BytesEncoder(Text=srmesh, Compress=Toggle(True))
trigger = Trigger(Interval=100, TimerInterval=100, Target=mmf_2)  # disabled

# ----
# Encryption: Description:
# Encrypt binary data using the AES symmetric encryption algorithm with a password.
# 
# Usage:
# - Secure data transmission for cross-machine communication.
# 
# Warning:
# - Encryption and decryption will take additional time.
# Data Encryption
mesh_2 = Mesh(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)
srmesh_2 = SerializeMesh(Mesh=mesh_2)
enb_2 = BytesEncoder(Text=srmesh_2, Password="password123", Compress=Toggle(True))

# ----
# Mesh Serialization + compression
# Compression: Description:
# Compress binary data using the GZip algorithm.
# 
# Usage:
# - Ideal for transmitting large data as it reduces payload size, bandwidth, and memory usage, while increasing transmission speed.
# 
# Warning:
# - Not suitable for small data as it may increase the size.
mesh_3 = Mesh(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)
srmesh_3 = SerializeMesh(Mesh=mesh_3)
enb_3 = BytesEncoder(Text=srmesh_3, Compress=Toggle(True))

# ----
# Point Serialization
pt = Point([Point(2.174324685, -5.670873841, 0), Point(6.052849799, -3.32025256, 0), Point(-0.3525931922, -0.9108657465, 0), Point(-4.936304691, -1.145927875, 0), Point(-7.463222568, -5.141984053, 0), Point(-1.057779577, -8.080260655, 0), Point(6.111615331, -8.315322783, 0), Point(0.9402485125, -5.494577245, 0), Point(-1.880497025, -2.438769579, 0), Point(2.585683409, 2.908893836, 0), Point(-5.347663415, 5.729639373, 0), Point(-9.872609382, 3.379018092, 0), Point(-13.16347918, -1.557286599, 0), Point(-16.10175578, -5.905935969, 0), Point(-11.75310641, -8.961743635, 0), Point(-5.700256607, -9.490633423, 0)])
srpt = SerializePoints(Points=pt)

# ----
# Serialization: Description:
# Serialize geometry to a JSON string with common properties, enabling receivers to understand and reconstruct the geometry. The serialized data is generic and not platform-specific.
# 
# Usage:
# - Facilitates the transmission and reconstruction of geometry data across different programs.
# Mesh Serialization
mesh_4 = Mesh(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)
srmesh_4 = SerializeMesh(Mesh=mesh_4)

# ----
# Curve Serialization
crv = Curve(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)
srcrv = SerializeCurve(Curves=crv)

# ----
# Network Informations
info = NetworkInfo()  # -> Properties, LocalIP
panel_3 = Panel(info.Properties)
your_main_local_ip = Panel(info.LocalIP)

enb_4 = BytesEncoder(Text=srmesh_3, Compress=False)
serialized_points = Panel(srpt)
serialized_mesh = Panel(srmesh_4)
serialized_curve = Panel(srcrv)
compressed_encrypted = Panel(enb_2)
compressed = Panel(enb_3)
uncompressed = Panel(enb_4)

# ----
# Data Decryption
panel_4 = Panel("password123")
deb = BytesDecoder(Bytes=enb_2, Password=panel_4)
dsrmesh = DeserializeMesh(JsonData=deb)
panel_5 = Panel(dsrmesh)

# ----
# Point Deserialization
dsrpt = DeserializePoints(JsonData=srpt)
deserialized_points = Panel(dsrpt)

# ----
# Curve Deserialization
dsrcrv = DeserializeCurve(JsonData=srcrv)
deserialized_curve = Panel(dsrcrv)

# ----
# Mesh Deserialization + decompression
deb_2 = BytesDecoder(Bytes=enb_3)
dsrmesh_2 = DeserializeMesh(JsonData=deb_2)
panel_6 = Panel(dsrmesh_2)

# ----
# Mesh Deserialization
dsrmesh_3 = DeserializeMesh(JsonData=srmesh_4)
deserialized_mesh = Panel(dsrmesh_3)

# ----
# Encoder conversion
panel_7 = Panel("this is a string")
enb_5 = BytesEncoder(Text=panel_7, Compress=False)

bytes_2 = Bytes(enb_5)

panel_8 = Panel(bytes_2)

# ----
# Cannot convert other than string
mesh_5 = Mesh(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)

bytes_3 = Bytes(mesh_5)

panel_9 = Panel(bytes_3)

# ----
# Need to serialize geometry to JSON string first
mesh_6 = Mesh(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)
srmesh_5 = SerializeMesh(Mesh=mesh_6)

bytes_4 = Bytes(srmesh_5)

panel_10 = Panel(bytes_4)

# ----
# UDP require the server to be active before sending message.
# UDP
# UDP: Description:
# UDP provides fast, connectionless transmission.
# 
# Usage:
# - Ideal for payloads under 1472 bytes needing quick, straightforward transmission without connection setup or integrity checks (e.g., sending small instructions).
# - Supports cross-machine communication.
# 
# Warning:
# - Not suitable for payloads over 1472 bytes.
# - Data may become corrupted due to fragmentation.
number_slider = Slider(6000, range=0..10000)
udp = UDPSender(ServerIP="127.0.0.1", Port=number_slider, Bytes="hey there from client", Send=Button())
udp_2 = UdpReceiver(Port=number_slider, Start=Toggle(False))

deb_3 = BytesDecoder(Bytes=udp_2)

panel_11 = Panel(deb_3)

# ----
# WebSockets require the server to be active before establishing a connection.
# WebSockets
number_slider_2 = Slider(6001, range=0..10000)
ws_client = WebSocketClient(HostIP="127.0.0.1", Port=number_slider_2, Route="/test", Bytes=enb, Send=Button())
ws_server = WebSocketServer(Port=number_slider_2, Route="/test", Start=Toggle(False))

deb_4 = BytesDecoder(Bytes=ws_server)
dsrmesh_4 = DeserializeMesh(JsonData=deb_4)

panel_12 = Panel(dsrmesh_4)

# ----
# File I/O: Description:
# File I/O operations allow reading from and writing to files on a storage device.
# 
# Usage:
# - Suitable for scenarios requiring persistent storage of data.
# 
# Warning:
# - Limited to the local machine.
# - Disk I/O operations can be slow compared to memory operations.
# File I/O require the data to be written first before reading it.
# File I/O
panel_13 = Panel("hey there from grasshopper")
file = FileWriter(Bytes=panel_13, FilePath="D:\test.txt", Write=Button())
file_2 = FileReader(FilePath="D:\test.txt")

deb_5 = BytesDecoder(Bytes=file_2)

panel_14 = Panel(deb_5)

# ----
# Named pipe require the server to be active before establishing a connection.
# Named Pipe
# Memory Mapped File: Description:
# Memory-Mapped Files map a portion of memory to the address space of a process for efficient inter-process communication (IPC).
# 
# Usage:
# - Ideal for extremely fast read and write operations directly in shared memory.
# 
# Warning:
# - Limited to the local machine.
# - May cause data corruption, memory leaks, or program crashes if not handled properly.
panel_15 = Panel("hey there from pipe ")
pipe = PipeSender(PipeName="TestPipe", Bytes=panel_15, Send=Toggle(False))
pipe_2 = PipeReceiver(PipeName="TestPipe", Start=Toggle(False))

deb_6 = BytesDecoder(Bytes=pipe_2)

panel_16 = Panel(deb_6)

# ----
# Memory Mapped File
panel_17 = Panel("hey there from mmf ")
# Memory Mapped File require the data to be written first before reading it.
panel_18 = Panel("TestMemoryBlock")
mmf = SharedMemoryWriter(MemoryName=panel_18, Bytes=panel_17, Write=Toggle(False))

mmf_2 = SharedMemoryReader(MemoryName=panel_18)
deb_7 = BytesDecoder(Bytes=mmf_2)

panel_19 = Panel(deb_7)
