# Grasshopper definition simulation-render-loop.gh (Grasshopper 1.0.7)
# plug-ins: Kangaroo2 Components, Portal, Weaverbird

# ---- group: Receiver
pipe = PipeReceiver(PipeName="channel-2", Start=Toggle(False))
deb = BytesDecoder(Bytes=pipe)
panel = Panel(deb)
c_script = CSharpScript(V=panel)  # -> A; inputs V: String
# ---------- c_script: C# ----------
    // nothing there
# ---------- end c_script ----------

# ---- group: Simulation
number_slider = Slider(30, range=0..100)
number_slider_2 = Slider(20, range=0..100)
rectangle = Rectangle(Plane=PlaneXY(0, 0, 0), XSize=number_slider_2, YSize=number_slider, Radius=0)  # -> Rectangle, Length
mplane = MeshPlane(Boundary=rectangle.Rectangle, WidthCount=number_slider_2, HeightCount=number_slider)  # -> Mesh, Area
nv = NakedVertices(Mesh=mplane.Mesh)  # -> ClothedIndex, NakedIndex, ClothedPts, NakedPts
pt = Point([Point(20.12338753, 17.29878898, 0), Point(-0.04125581901, 2.19337515, 0), Point(-0.2942172947, 27.70634684, 0)])
cp = ClosestPoint(Point=nv.NakedPts, Cloud=pt)  # -> ClosestPoint, CPIndex, Distance
demesh = DeconstructMesh(Mesh=mplane.Mesh)  # -> Vertices, Faces, Colours, Normals
bnd = Bounds(Numbers=cp.Distance)
remap = RemapNumbers(Value=cp.Distance, Source=bnd, Target=Domain(0, 1))  # -> Mapped, Clipped
Z = UnitZ(Factor=1)
smaller = SmallerThan(FirstNumber=remap.Mapped, SecondNumber=Slider(0.1, range=0..1))  # -> SmallerThan, OrEqualTo
edgelengths = EdgeLengths(Mesh=mplane.Mesh, LengthFactor=Slider(0.1, range=0..0.1), Strength=1)
cull = CullPattern(List=nv.NakedPts, CullPattern=smaller.OrEqualTo)
load = Load(Point=demesh.Vertices, ForceVector=Z, Weighting=Slider(0.07, range=0..0.1))
show = Show(G=mplane.Mesh)
anchor = Anchor(Point=cull, Strength=10000)
merge = Merge(Data1=edgelengths, Data2=anchor, Data3=load, Data4=show, Data5=c_script)  # -> flatten(Result)
trigger = Trigger(Interval=10, TimerInterval=10, Target=stepsolver)  # disabled
stepsolver = StepSolver(
    GoalObjects=merge,
    Tolerance=0.0001,
    Momentum=False,
    Damping=0.99,
    SubIterations=Slider(2, range=0..10),
    Animate=Toggle(True))  # -> I, V, O
item = ListItem(List=stepsolver.O, Index=0, Wrap=True)
panel_2 = Panel(stepsolver.I)
mesh = Mesh(item)
wbthicken = WeaverbirdsMeshThicken(MeshCurves=mesh, Distance=Slider(0.2, range=0..1), OffsetType=0)

# ---- group: Sender
srgeo = SerializeGeometry(Geometry=wbthicken)
pack = PackPayload(Payloads=srgeo, isBeautify=False)
enb = BytesEncoder(Text=pack, Compress=Toggle(True))
pipe_2 = PipeSender(PipeName="channel-1", Bytes=enb, Send=Toggle(False))

# ---- group: Camera
camera = GetCamera()
enb_2 = BytesEncoder(Text=camera, Compress=False)
pipe_3 = PipeSender(PipeName="channel-3", Bytes=enb_2, Send=Toggle(False))
